# Grasshopper definition panels.gh (Grasshopper 0.9.76)

crv = Curve([<curve referenced from the Rhino model> x72])
number_slider = Slider(0.1, range=0..1)
resolution = Slider(30, range=1..200)
panel = Panel("Deformation Profile")
crv_2 = Curve([<curve referenced from the Rhino model> x72])
ext = ExtendCurve(Curve=crv, Type=0, Start=number_slider, End=number_slider)
# Distort Surface With Curves
radius = Slider(0.5, range=0..30)
srf = Surface(<surface referenced from the Rhino model>)
divdist = DivideDistance(Curve=ext, Distance=Slider(0.3, range=0.3..10))  # -> Points, Tangents, Parameters
random_seed = Slider(140, range=0..200)
nurbs = NurbsCurve(Vertices=divdist.Points, Degree=3, Periodic=False)  # -> Curve, Length, Domain
int = ConstructDomain(DomainStart=expr("-x", radius), DomainEnd=radius)
lng = ListLength(List=crv_2)
divide = DivideSurfaceOBSOLETE(Surface=reparameterize(srf), UCount=resolution, VCount=resolution)  # -> Points, Normals, Parameters
end = EndPoints(Curve=nurbs.Curve)  # -> Start, End
eval = EvaluateSurface(Surface=reparameterize(srf), Point=divide.Parameters)  # -> Point, Normal, Frame
random = Random(Range=int, Number=lng, Seed=random_seed, Integers=False)
graft = GraftTree(Data=divide.Points, Strip=False)
lng_2 = ListLength(List=[end.Start, end.End])
crv_cp = CurveClosestPoint(Point=graft, Curve=crv_2)  # -> Point, Parameter, Distance
series = Series(Start=Slider(-0.093, range=-5..5), Step=expr("0", 1), Count=lng_2)
# To calculate a random radius for each curve, connect this to "radius"
radius_2 = Number(radius)
pts = Point(crv_cp.Point)
pdecon = Deconstruct(Point=pts)  # -> XComponent, flatten(YComponent), ZComponent
Z = UnitZ(Factor=series)
pdeform = PointDeform(Geometry=nurbs.Curve, Points=[end.Start, end.End], Motion=Z)
dist = Distance(PointA=pts, PointB=graft)
remap = RemapNumbers(Value=pdecon.YComponent, Source=Domain(25, -25), Target=Domain(0, 2))  # -> Mapped, Clipped
minus = Subtraction(FirstNumber=0.5, SecondNumber=dist)
max = Maximum(FirstNumber=minus, SecondNumber=0)
ma = MassAddition(Input=max)  # -> Result, PartialResult
sort = SortList(Keys=flatten(ma.Result))  # -> List, ValuesA
mult = Multiplication(FirstNumber=1, SecondNumber=max)
Z_2 = UnitZ(Factor=Slider(-0.08, range=-1..0))
rev = ReverseList(List=sort.List)
move = Move(Geometry=pdeform, Motion=Z_2)  # -> Geometry, Transform
ma_2 = MassAddition(Input=mult)  # -> Result, PartialResult
item = ListItem(List=flatten(rev), Index=0, Wrap=False)
div = Division(FirstNumber=ma_2.Result, SecondNumber=item)
abs = F1(Function="abs(x)", X=div)
receiver = Receiver(abs, DrawTag=True, DrawWires=1)
# Play around with different kinds of Graph Mappers for this. Linear creates cones, Bezier can create roughly spherical bulges, sine can create waves, and sine summation can create rippled bulges.
graph = GraphMapper(
    receiver,
    x0=0,
    x1=1,
    y0=0,
    y1=1,
    container_name="Bezier",
    cpx=[0, 0.3201794326, 0.9919235706, 1],
    cpy=[0, 0.006640255451, 0.705560565, 1])
receiver_2 = Receiver(graph, DrawTag=True, DrawWires=1)
div_2 = Division(FirstNumber=div, SecondNumber=abs)
surface_normal = Vector(eval.Normal)
mult_2 = Multiplication(FirstNumber=receiver_2, SecondNumber=div_2)
graft_2 = GraftTree(Data=surface_normal, Strip=False)
mult_3 = Multiplication(FirstNumber=mult_2, SecondNumber=item)
X = UnitX(Factor=mult_3)
# The direction of point displacement can be set to any of the principal axes or to the normal of the original surface.
Z_3 = UnitZ(Factor=mult_3)
Y = UnitY(Factor=mult_3)
mul = Multiply(Vector=graft_2, Factor=mult_3)  # -> Vector, Length
displacement_vector = Vector(Z_3)
move_2 = Move(Geometry=flatten(divide.Points), Translation=flatten(displacement_vector))
# Disconnect custom preview if it's running slowly - but know that the surface geometry preview is much rougher than it will actually be when you bake it.
srfgrid = SurfaceFromPoints(Points=move_2, UCount=expr("x+1", resolution), Interpolate=False)
preview = CustomPreview(
    Geometry=srfgrid,
    Shader={ambient=RGB(255, 255, 255), diffuse=RGB(255, 128, 128), emission=RGB(0, 0, 0), shine=0, specular=RGB(255, 255, 255), transparency=0.6})
